# Dynamo graph CreateFloors.dyn (Dynamo 1.3.0.875)

categories = Categories("Levels")
all_elements_of_category = ElementsOfCategory(categories)
select_model_elements = DSModelElementsSelection()
# note: selected model filled region model elements
select_model_element = DSModelElementSelection()
geometry = Element.Geometry(select_model_element)
code_block = CodeBlock { 0; }
# note: remove surface first item of index.  Lacing longest
removeItemAtIndex = List.RemoveItemAtIndex(list=geometry, indices=code_block)
floor_types = FloorTypes("S12")
levels = Levels("Level 1")
code_block_2 = CodeBlock { true; }
python_script = Python(IN[0]=removeItemAtIndex, IN[1]=floor_types, IN[2]=levels, IN[3]=code_block_2)
# ---------- python_script.python (36 lines) ----------
import clr
clr.AddReference('ProtoGeometry')
from Autodesk.DesignScript.Geometry import *

clr.AddReference("RevitAPI")
import Autodesk
from Autodesk.Revit.DB import *

clr.AddReference("RevitServices")
import RevitServices 
from RevitServices.Persistence import DocumentManager
from RevitServices.Transactions import TransactionManager

clr.AddReference("RevitNodes")
import Revit
clr.ImportExtensions(Revit.Elements)
clr.ImportExtensions(Revit.GeometryConversion)

doc = DocumentManager.Instance.CurrentDBDocument

ArrayCurves = IN[0]
floorType = UnwrapElement(IN[1])
levels = UnwrapElement(IN[2])
structural = IN[3]

curveArray = CurveArray()

for c in ArrayCurves:
    curveArray.Append(c.ToRevitType())

TransactionManager.Instance.EnsureInTransaction(doc)
newFloor = doc.Create.NewFloor(curveArray, floorType, levels, structural)
out = newFloor.ToDSType(False)
TransactionManager.Instance.TransactionTaskDone()

OUT = out
# ----------------------------------------
watch = Watch(python_script)
