# Dynamo graph ExcelWrite.dyn (Dynamo 1.3.0.875)

file_path = Filename(".\Sheets Write.xlsx")
categories = Categories("Sheets")
all_elements_of_category = ElementsOfCategory(categories)
sheetName = Sheet.SheetName(all_elements_of_category)
python_script = Python(IN[0]=file_path, IN[1]=sheetName)
# ---------- python_script.python (24 lines) ----------
import clr

clr.AddReference('Microsoft.Office.Interop.Excel, Version=11.0.0.0, Culture=neutral, PublicKeyToken=71e9bce111e9429c')
from Microsoft.Office.Interop import Excel
from System import Array

path = IN[0]

ex = Excel.ApplicationClass()
ex.Visible = True
ex.DisplayAlerts = False

workbook = ex.Workbooks.Open(path)
ws = workbook.Worksheets[1]
i = 0
x1range = ws.Range["A1", "A4"]
sheetName = IN[1]
a = Array.CreateInstance(object, len(sheetName),1) # row and column

while i < len(sheetName):
    a[i,0] = sheetName[i]
    i += 1

x1range.Value2 = a
# ----------------------------------------
watch = Watch(python_script)
